% Simulink data dictionary DataDictionaryAutoTransmission.sldd

EngineMap = [-40 -44 -49 -53 -57 -61 -65 -70 -74 -78 -82
 215 117 85 66 44 29 10 -2 -13 -22 -32
 245 208 178 148 122 104 85 66 48 33 18
 264 260 241 219 193 167 152 133 119 96 85
 264 279 282 275 260 238 223 208 189 171 152
 267 290 293 297 290 275 260 256 234 212 193
 267 297 305 305 305 301 293 282 267 249 226
 267 301 308 312 319 323 319 316 297 279 253
 267 301 312 319 327 327 327 327 312 293 267
 267 301 312 319 327 334 334 334 319 305 275]

Iei = 0.02199149
SpeedVector = [800 1200 1600 2000 2400 2800 3200 3600 4000 4400 4800]
TorqueVector = [0; 20; 30; 40; 50; 60; 70; 80; 90; 100]

TorqueConvertorData = [0 137.4652 2.232
 0.1 137.065 2.075
 0.2 135.8644 1.975
 0.3 135.6644 1.846
 0.4 137.5653 1.72
 0.5 140.3666 1.564
 0.6 145.2689 1.409
 0.7 152.8725 1.254
 0.8 162.9773 1.096
 0.81 164.2779 1.08
 0.82 166.1788 1.061
 0.83 167.9797 1.043
 0.84 170.0807 1.028
 0.85 172.782 1.012
 0.86 175.3832 1.002
 0.87 179.5852 1.002
 0.88 183.5871 1.001
 0.89 189.8901 0.998
 0.9 197.6938 0.999
 0.92 215.9024 1.001
 0.94 244.516 1.002]

VehicleData = [3.23; 40; 0.02; 1; 12.09415; 0]

downTable = [0 5 20 35
 0 5 20 35
 0 5 25 40
 0 5 30 50
 0 30 50 80
 0 30 50 80]

upTable = [10 30 50 1000000
 10 30 50 1000000
 15 30 50 1000000
 23 41 60 1000000
 40 70 100 1000000
 40 70 100 1000000]

downThresholdBP = [0; 5; 40; 50; 90; 100]
upThresholdBP = [0; 25; 35; 50; 90; 100]
TWAIT = 2